# Grasshopper definition Lattic3_example.gh (Grasshopper 1.0.8)
# plug-ins: Lattic3.Components

# ---- group: Atomized Section
# T :  index of standard tubular section
T = ValueList({"33.7 x 2.6": 0, "33.7 x 2.9": 1, "33.7 x 3.2": 2, "42.4 x 2.6": 3, "42.4 x 2.9": 4, "42.4 x 3.2": 5, "48.3 x 2.6": 6, "48.3 x 2.9": 7, "48.3 x 3.2": 8, "60.3 x 2.9": 9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}, selected="114.3 x 3.6": 20)
# α : material reduction coefficient
α = ValueList({"1.5", "2", "3"}, selected="3")
# Ar: atoms rounding coefficient
ar = ValueList({"original n": 0, "nearest even number": 1, "nearest odd number": 2}, selected="original n")
# Ad: atoms doubling coefficient
# D: diameter of minimum load bearing section
# Sn: number of control sections along the height
# St: shape profile section type
# Lm: Linear range minimum value
# LM: Linear range maximum value
# Pm: Parabolic range minimum value
# PM: Parabolic range maximum value
# PE: parabola eccentricity coefficient
ad = ValueList({"n": 0, "2n": 1}, selected="n")
# N: number of points of the atomized section
# D: diameter of minimum load bearing section
cmp_sec = Compute_Section(StandardTubularSectionIndex=T, MaterialReductionCoefficient=α, RoundingCoefficient=ar, DoublingCoefficient=ad)  # -> N, D

# ---- group: Shape Profile
S = ValueList({"Constant": 0, "Linear": 1, "Parabolic": 2}, selected="Linear")
lm = Slider(1, range=1..10)
lm_2 = Slider(1.937, range=1..10)
pm = Slider(1.483, range=1..10)
pm_2 = Slider(2.198, range=1..10)
pe = Slider(0, range=-10..10)

# ---- group: Diagrid
M = Slider(13, range=3..50)
H = Slider(1000, range=0..10000)

# ---- group: Shape Profile (continued)
# N: number of points of the atomized section
# M: number of control sections along the height
# Rs: control sections radia (mm)
# Hn: normalized control section heights
cmp_shp = Compute_Shape(
    DiameterOfMinimumLoadBearingSection=cmp_sec.D,
    NumberOfControlSectionsAlongTheHeight=M,
    ShapeProfileSectionType=S,
    LinearRangeMinimumValue=lm,
    LinearRangeMaximumValue=lm_2,
    ParabolicRangeMinimumValue=pm,
    PM=pm_2,
    PE=pe)  # -> Rs, Hn

# ---- group: Control Sections mapping
# H: total height (mm)
# Rs: control sections radia (mm)
# Hs: control section heights (mm)
# Hn: remapped control section heights
graph = GraphMapper(cmp_shp.Hn, x0=0, x1=1, y0=0, y1=1, Cx=0.6175436974, Cy=0.4853801131, container_name="Conic")

# ---- group: Diagrid (continued)
cmp_dgd = Compute_DiagridGh(N=cmp_sec.N, NumberOfControlSectionsAlongTheHeight=M, TotalHeightInMm=H, Rs=cmp_shp.Rs, Hs=graph)  # -> CCW, CW

# ----
crv = Curve(cmp_dgd.CW)
crv_2 = Curve(cmp_dgd.CCW)
